vi "index.gviweb"   [LabVIEW NXG 5.1.0]
# This example demostrates using the JavaScript Library Interface (JSLI) as a simple 4-bit calculator.
panel controls:
  "GitHub Hyperlink": string = "https://github.com/ni/webvi-examples"
  "error in": error
  "expid": string = "RIP MATLAB"
  "host": string = "127.0.0.1"
  "port": string = "8080"
  "stop": bool
  "variable": string = "time"
  "Period": u32 = 100
panel indicators:
  "banner": string
  "error out": error
  "value": string
uses:
  Calculator Library::RIPClient.jsli::Connect
  Calculator Library::RIPClient.jsli::Get
diagram:
  sequence {
    frame 0 {
      call "Connect"(expid=$expid, host=$host, port=$port, error in=$"error in") -> (error out=w1)
      $"error out" <- w1
    }
    frame 1 {
      while {
        call "Get"(variable=$variable) -> (return=w2)
        $value <- w2
        Wait Until Next Multiple(multiple to wait=$Period)
        stop if $stop
      }
    }
  }
